# Grasshopper definition live_solve_showcase.ghx (Grasshopper 1.0.8)
# plug-ins: Selva

mode_options = ValueList({"Spheres", "Voronoi cells"}, selected="Spheres")
radius_scale = Slider(1, range=0.2..3)
ui_bridge = UIBridge(
    Enable=Toggle(True),
    Schema="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",
    Values="{\"b727a278-8586-4e3e-a57f-8fd189003cea\":1,\"03398815-8e1e-40eb-9f6e-f773c9296a65\":154,\"7830acd3-605c-4c43-8f2e-5653d701fe68\":\"warm\",\"be715bd1-c593-4954-9a1b-529d4056d0df\":\"Spheres\"}")  # -> Schema, URL
get_integer = GetInteger(Slider(10, range=10..250), AtLeast=1, AtMost=1, Maximum=2147483647, Minimum=-2147483648, TreeAccess=False)
radius_scale_2 = GetNumber(radius_scale, AtLeast=1, AtMost=1, Maximum=1.797693135e+308, Minimum=-1.797693135e+308, TreeAccess=False)
mode = GetValueList(
    mode_options,
    AtLeast=1,
    AtMost=1,
    Immediate=True,
    ListAccess=False,
    StoredItems="""[
  {
    "name": "Spheres",
    "expression": "Spheres"
  },
  {
    "name": "Voronoi cells",
    "expression": "Voronoi cells"
  }
]""",
    TreeAccess=False)
c_bake = ContextBake(Content=ui_bridge.Schema)
mode_text = Text(mode)
mode_2 = ContextPrint(Text=mode)
random = Random(Range="1 to 100", Number=get_integer, Seed=2)
random_2 = Random(Range="1 to 100", Number=get_integer, Seed="29")
random_3 = Random(Range="1 to 100", Number=get_integer, Seed="12")
random_4 = Random(Range="1 to 20", Number=get_integer, Seed="20")
panel = Panel("""Spheres
Voronoi cells""")
panel_2 = Panel("""warm
cool
mono
rainbow""")
integer = Integer(random_4)
mode_index = MemberIndex(Set=panel, Member=mode_text)  # -> Index, Count
construct_point = ConstructPoint(XCoordinate=random, YCoordinate=random_2, ZCoordinate=random_3)
multiplication = Multiplication(A=integer, B=radius_scale_2)
voronoi_box = CenterBox(Base=PlaneXY(50.5, 50.5, 50.5), X=52, Y=52, Z=52)
palette_colours = Colour([RGB(224, 122, 95), RGB(88, 150, 214), RGB(140, 140, 140), RGB(160, 90, 220)])
sphere = Sphere(Base=construct_point, Radius=multiplication)
voronoi³ = Voronoi3D(Points=construct_point, Box=voronoi_box)  # -> Cells, Boundary
panel_3 = Panel(""""Warm" = warm
"Cool" = cool
"Mono" = mono""")
panel_4 = Panel(""""Warm" = warm
"Cool" = cool
"Mono" = mono
"Rainbow" = rainbow""")
list_length = ListLength(List=sphere)
larger = LargerThan(FirstNumber=list_length, SecondNumber=100)  # -> LargerThan, OrEqualTo
volume = Volume(Geometry=voronoi³.Cells)  # -> Volume, Centroid
smaller_than = SmallerThan(FirstNumber="40", SecondNumber=list_length)  # -> SmallerThan, OrEqualTo
larger_than = LargerThan(FirstNumber=list_length, SecondNumber="60")  # -> LargerThan, OrEqualTo
sphere_count = ContextPrint(SphereCount=list_length)
palette_options = StreamFilter(Gate=larger.LargerThan, Stream0=panel_3, Stream1=panel_4)
palette = GetDynamicValueList(
    palette_options,
    AtLeast=1,
    AtMost=1,
    Immediate=True,
    ListAccess=False,
    StoredItems="""[
  {
    "name": "Warm",
    "expression": "warm"
  },
  {
    "name": "Cool",
    "expression": "cool"
  },
  {
    "name": "Mono",
    "expression": "mono"
  },
  {
    "name": "Rainbow",
    "expression": "rainbow"
  }
]""",
    TreeAccess=False)
palette_text = Text(palette)
palette_index = MemberIndex(Set=panel_2, Member=palette_text)  # -> Index, Count
palette_colour = ListItem(List=palette_colours, Index=palette_index.Index, Wrap=True)
smaller = SmallerThan(FirstNumber=list_length, SecondNumber=200)  # -> SmallerThan, OrEqualTo
smaller_2 = SmallerThan(FirstNumber=radius_scale_2, SecondNumber=2)  # -> SmallerThan, OrEqualTo
equals = Equality(FirstNumber=mode_index.Index, SecondNumber=0)  # -> Equality, Inequality
panel_5 = Panel("More than 200 spheres is too heavy for the web viewer: refused")
shrink_cells = Scale(Geometry=voronoi³.Cells, Center=volume.Centroid, Factor=0.8)  # -> Geometry, Transform
colour_swatch = ColourSwatch(SwatchColor=RGB(207, 107, 107))
set_palette = SetDynamicValueList(Options=palette_options)
three_material = ThreeMaterial(Color=palette_colour, Metalness=0, Roughness=Slider(0.23, range=0..1), Opacity=1, Transparent=False)
message = Message(Condition=smaller_than.SmallerThan, Message="Only a few spheres", Level=1)
message_2 = Message(Condition=larger_than.LargerThan, Message="You got a lot of spheres", Level=0)
too_many = Message(Condition=smaller.SmallerThan, Message=panel_5, Level=2)
overlap = Message(Condition=smaller_2.SmallerThan, Message="Radius scale above 2 makes the spheres overlap heavily", Level=1)
voronoi_note = Message(Condition=equals.Equality, Message="Voronoi cells take a moment for many points", Level=0)
pick_geometry = StreamFilter(Gate=mode_index.Index, Stream0=sphere, Stream1=shrink_cells.Geometry)
palette_options_2 = ContextBake(Content=set_palette)
display = Display(Geo=pick_geometry, Material=three_material)
context_bake = ContextBake(Content=display)
